# Grasshopper definition CellPhoneStand_Simple-1-qz.gh (Grasshopper 1.0.7)
# plug-ins: ShapeDiverForGrasshopper

# notes: We are going to explore cell phone stand designs that are spherical. We will begin with an origin for our designs.
# Let us create a plane, which includes a point.
xy = XYPlane(Origin=Point(0, 0, 0))
pln_cell_phone_stand_design_origin = Plane(xy)
# Side Lengh of the box (up-down)
void_width_mm = Slider(255, range=0..12000)
# notes: Spheres will roll, so we need a flat surface at the base of the stand. To create the flat surface we create a volume we want to subtract from the sphere. Here we create a rectangle and then a box with a negative height.
panel = Panel("flat base: Sphere-Box")
void_height_mm = Slider(-300, range=-300..0)
panel_2 = Panel("The Box")
num = Number(void_width_mm)
# notes: we have turned off 'preview' for these objects to limit what we see.
panel_3 = Panel("side length/2")
division = Division(A=num, B="2")
pln_cell_phone_stand_design_origin_2 = Plane(pln_cell_phone_stand_design_origin)
negative = Negative(Value=Slider(38, range=0..100))
neg = Negative(Value=division)
# notes: there are many ways to create a box. Here we create a rectangle, and then use a BoxRec object with an input of our base rectangle and a height.
panel_4 = Panel("A: 127.5")
panel_5 = Panel("B: -127.5")
num_void_height = Number(void_height_mm)
dom = ConstructDomain(DomainStart=division, DomainEnd=neg)
# Side Lengh of the box (up-down)
number_slider = Slider(37, range=0..100)
negative_2 = Negative(Value=Slider(25, range=0..100))
domain = Domain(dom)
void_height = Panel(num_void_height)
construct_point = ConstructPoint(XCoordinate=negative, YCoordinate=Slider(15, range=0..100), ZCoordinate=Slider(19, range=0..100))
void_domain = Panel(domain)
num_void_height_2 = Number(Slider(5, range=0..100))
rectangle = Rectangle(Plane=construct_point, XSize=negative_2, YSize=Slider(5, range=0..100), Radius=0)  # -> Rectangle, Length
construct_point_2 = ConstructPoint(XCoordinate=Slider(38, range=0..100), YCoordinate=Slider(15, range=0..100), ZCoordinate=Slider(19, range=0..100))
construct_point_3 = ConstructPoint(XCoordinate=0, YCoordinate=0, ZCoordinate=Slider(23, range=0..100))
num_2 = Number(number_slider)
rectangle_2 = Rectangle(Plane=pln_cell_phone_stand_design_origin_2, XSize=domain, YSize=domain, Radius=0)  # -> Rectangle, Length
construct_point_4 = ConstructPoint(XCoordinate=0, YCoordinate=0, ZCoordinate=Slider(16, range=0..100))
num_void_height_3 = Number(Slider(5, range=0..100))
panel_6 = Panel("side length/2")
division_2 = Division(A=num_2, B="2")
rectangle_3 = Rectangle(Plane=construct_point_2, XSize=Slider(25, range=0..100), YSize=Slider(5, range=0..100), Radius=0)  # -> Rectangle, Length
construct_point_5 = ConstructPoint(XCoordinate=0, YCoordinate=0, ZCoordinate=Slider(23, range=0..100))
boxrec = BoxRectangle(Rectangle=rectangle.Rectangle, Height=num_void_height_2)
construct_point_6 = ConstructPoint(XCoordinate=0, YCoordinate=0, ZCoordinate=Slider(16, range=0..100))
panel_7 = Panel("box=Rectangle*Height")
boxrec_2 = BoxRectangle(Rectangle=rectangle.Rectangle, Height=num_void_height_2)
boxrec_3 = BoxRectangle(Rectangle=rectangle_2.Rectangle, Height=num_void_height)
neg_2 = Negative(Value=division_2)
move = Move(Geometry=boxrec, Motion=construct_point_3)  # -> Geometry, Transform
move_2 = Move(Geometry=boxrec_2, Motion=construct_point_4)  # -> Geometry, Transform
# notes: The result is a Box we will use as a void to remove any part of the design model that projects below the origin plane.
void_height_2 = Panel(boxrec_3)
neg_3 = Negative(Value=Slider(60, range=0..100))
boxrec_4 = BoxRectangle(Rectangle=rectangle_3.Rectangle, Height=num_void_height_3)
boxrec_5 = BoxRectangle(Rectangle=rectangle.Rectangle, Height=num_void_height_2)
boxrec_6 = BoxRectangle(Rectangle=rectangle_3.Rectangle, Height=num_void_height_3)
panel_8 = Panel("A: 127.5")
num_void_height_4 = Number(Slider(26, range=0..100))
dom_2 = ConstructDomain(DomainStart=division_2, DomainEnd=neg_2)
move_3 = Move(Geometry=boxrec_4, Motion=construct_point_5)  # -> Geometry, Transform
move_4 = Move(Geometry=boxrec_5, Motion=Vector(0, 0, 10))  # -> Geometry, Transform
move_5 = Move(Geometry=boxrec_6, Motion=construct_point_6)  # -> Geometry, Transform
unit_y = UnitY(Factor=1)
boxrec_7 = BoxRectangle(Rectangle=rectangle_3.Rectangle, Height=num_void_height_3)
area = Area(Geometry=move.Geometry)  # -> Area, Centroid
domain_2 = Domain(dom_2)
void_height_3 = Panel(num_void_height_4)
pln_cell_phone_stand_design_origin_3 = Plane(pln_cell_phone_stand_design_origin_2)
move_6 = Move(Geometry=boxrec_7, Motion=Vector(0, 0, 10))  # -> Geometry, Transform
void_domain_2 = Panel(domain_2)
unit_y_2 = UnitY(Factor=1)
brep_void = Brep(boxrec_3)
area_2 = Area(Geometry=move_3.Geometry)  # -> Area, Centroid
area_3 = Area(Geometry=move_4.Geometry)  # -> Area, Centroid
negative_3 = Negative(Value=Slider(79, range=0..100))
unit_y_3 = UnitY(Factor=1)
rectangle_4 = Rectangle(Plane=pln_cell_phone_stand_design_origin_2, XSize=domain_2, YSize=neg_3, Radius=0)  # -> Rectangle, Length
negative_4 = Negative(Value=Slider(34, range=0..100))
rotate_3d = Rotate3D(Geometry=move.Geometry, Angle=negative_4, Center=area.Centroid, Axis=unit_y)  # -> Geometry, Transform
area_4 = Area(Geometry=move_6.Geometry)  # -> Area, Centroid
unit_y_4 = UnitY(Factor=1)
boxrec_8 = BoxRectangle(Rectangle=rectangle_4.Rectangle, Height=num_void_height_4)
rotate_3d_2 = Rotate3D(Geometry=move_3.Geometry, Angle=Slider(34, range=0..100), Center=area_2.Centroid, Axis=unit_y_2)  # -> Geometry, Transform
rotate_3d_3 = Rotate3D(Geometry=move_4.Geometry, Angle=negative_3, Center=area_3.Centroid, Axis=unit_y_3)  # -> Geometry, Transform
phone_length_mm = Slider(165, range=0..300)
phone_corner_radius_mm = Slider(5, range=0..300)
# notes: This is a tolerance for the output.  This is related to the fabrication technique, a tolerance of 1 mm should be plenty.  If the fit is too loose, reduce this to 0.5mm.
phone_thickness = Slider(13, range=0..300)
# notes: Adjust the parameters until this model represents the phone you are designing for.
# notes: These parameters relate to how the phone will be used while in this stand.
phone_viewing_angle = Slider(74, range=0..360)
portrait_landscape = ValueList({"portrait 0": "0", "landscape 90": "90", "portrait 180": "180", "landscape 270": "270"}, selected="portrait 0")
# notes: These parameters relate to the dimensions of the phone
# [with the case on, if applicable].
phone_table_offset = Slider(20, range=0..300)
phone_tolerance_mm = Slider(1, range=0..2)
num_screen_inset = Slider(3, range=3..100)
num_projection_offset = Slider(90, range=0..200)
# notes: These parameters relate to the dimensions of the phone screen and viewing range. A void is created representing the viewing frustum.
phone_screen_offset_from_edge_mm = Slider(4, range=0..300)
num_projection_distance = Slider(200, range=0..200)
phone_width_mm = Slider(216, range=0..300)
rotate_3d_4 = Rotate3D(Geometry=move_6.Geometry, Angle=Slider(79, range=0..100), Center=area_4.Centroid, Axis=unit_y_4)  # -> Geometry, Transform
sphere_3_center_z = Slider(71, range=-100..100)
# notes: This is the model of the cell phone.
pln_cell_phone_stand_design_origin_4 = Plane(pln_cell_phone_stand_design_origin_2)
sphere_3_center_y = Slider(26, range=-100..100)
sphere_3_center_x = Slider(29, range=-100..100)
sphere_3_center_x_2 = Slider(-29, range=-100..100)
sphere_3_center_x_3 = Slider(10, range=-100..100)
sphere_3_center_x_4 = Slider(0, range=-100..100)
sphere_3_center_y_2 = Slider(52, range=-100..100)
sphere_2_center_z = Slider(46, range=-100..100)
sphere_2_center_z_2 = Slider(46, range=-100..100)
# notes: We have decided we want to be able to move the center of our spherical designs up and down relative to the design origin, so we add a 'move' transform. This moves the design origin in the Z direction [up/down] the distance given in the numeric slider
# move the origin z-axis
sphere_1_center_z = Slider(26, range=-100..100)
# notes: try adjusting this Z position
pln_cell_phone_stand_design_origin_5 = Plane(pln_cell_phone_stand_design_origin_3)
pln_cell_phone_stand_design_origin_6 = Plane(pln_cell_phone_stand_design_origin_3)
num_phone_thickness = Number(phone_thickness)
num_phone_width = Number(phone_width_mm)
num_phone_length = Number(phone_length_mm)
num_phone_corner_radius = Number(phone_corner_radius_mm)
num_phone_viewing_angle = Number(phone_viewing_angle)
num_phone_viewing_orientation = Number(portrait_landscape)
num_phone_table_offset = Number(phone_table_offset)
num_phone_fit_tolerance = Number(phone_tolerance_mm)
num_screen_inset_2 = Number(num_screen_inset)
num_screen_offset_from_edge = Number(phone_screen_offset_from_edge_mm)
num_projection_distance_2 = Number(num_projection_distance)
num_projection_offset_2 = Number(num_projection_offset)
brep_void_2 = Brep(brep_void)
solid_union = SolidUnion(Breps=[rotate_3d_3.Geometry, rotate_3d.Geometry, move_2.Geometry])
# notes: In the future we may need to do something if the spheres do not touch the origin plane as this means we are proposing they float in the air above the plane.
solid_union_2 = SolidUnion(Breps=[rotate_3d_4.Geometry, rotate_3d_2.Geometry, move_5.Geometry])
construct_point_7 = ConstructPoint(XCoordinate=sphere_3_center_x_2, YCoordinate=sphere_3_center_y, ZCoordinate=sphere_3_center_z)
construct_point_8 = ConstructPoint(XCoordinate=sphere_3_center_x, YCoordinate=sphere_3_center_y, ZCoordinate=sphere_3_center_z)
construct_point_9 = ConstructPoint(XCoordinate=sphere_3_center_x_4, YCoordinate=sphere_3_center_y_2, ZCoordinate=sphere_3_center_x_3)
Z = UnitZ(Factor=sphere_2_center_z)
Z_2 = UnitZ(Factor=sphere_2_center_z_2)
Z_3 = UnitZ(Factor=sphere_1_center_z)
panel_12 = Panel("small sphere origin")
panel_13 = Panel("big sphere origin")
move_7 = Move(Geometry=pln_cell_phone_stand_design_origin_5, Motion=Z_3)  # -> Geometry, Transform
move_8 = Move(Geometry=pln_cell_phone_stand_design_origin_5, Motion=construct_point_8)  # -> Geometry, Transform
move_9 = Move(Geometry=pln_cell_phone_stand_design_origin_5, Motion=construct_point_7)  # -> Geometry, Transform
move_10 = Move(Geometry=pln_cell_phone_stand_design_origin_5, Motion=construct_point_9)  # -> Geometry, Transform
move_11 = Move(Geometry=pln_cell_phone_stand_design_origin_5, Motion=Z)  # -> Geometry, Transform
move_12 = Move(Geometry=pln_cell_phone_stand_design_origin_5, Motion=Z_2)  # -> Geometry, Transform
negative_5 = Negative(Value=Slider(39, range=0..100))
# notes: Let us create 2 nested spheres.
pln_cell_phone_stand_sphere_1_origin = Plane(move_7.Geometry)
pln_cell_phone_stand_sphere_2_origin = Plane(move_11.Geometry)
cluster_cell_phone = ClusterCellPhone(
    pln_phone_location_on_table=pln_cell_phone_stand_design_origin_4,
    num_phone_viewing_angle=num_phone_viewing_angle,
    num_phone_viewing_orientation=num_phone_viewing_orientation,
    num_phone_table_offset=num_phone_table_offset,
    num_phone_width=num_phone_width,
    num_phone_length=num_phone_length,
    num_phone_corner_radius=num_phone_corner_radius,
    num_phone_thickness=num_phone_thickness,
    num_phone_fit_tolerance=num_phone_fit_tolerance,
    num_screen_offset_from_edge=num_screen_offset_from_edge,
    num_screen_projection_inset=num_screen_inset_2,
    num_projection_distance=num_projection_distance_2,
    num_projection_offset=num_projection_offset_2)  # -> pln_phone_origin_8, srf_phone_outline_surface_5, brep_phone_4, pln_phone_location_on_table_7, pln_phone_location_above_table_3, num_phone_volume_2, pt_phone_centroid_2, line_phone_center_of_gravity_2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
pln_cell_phone_stand_sphere_2_origin_2 = Plane(move_12.Geometry)
pln_cell_phone_stand_sphere_3_origin = Plane(move_9.Geometry)
pln_cell_phone_stand_sphere_3_origin_2 = Plane(move_8.Geometry)
pln_cell_phone_stand_sphere_3_origin_3 = Plane(move_10.Geometry)
number_slider_2 = Slider(23, range=0..100)
pln_cell_phone_stand_design_origin_7 = Plane(pln_cell_phone_stand_design_origin_6)
construct_point_10 = ConstructPoint(XCoordinate=Slider(39, range=0..100), YCoordinate=Slider(37, range=0..100), ZCoordinate=Slider(55, range=0..100))
construct_point_11 = ConstructPoint(XCoordinate=negative_5, YCoordinate=Slider(37, range=0..100), ZCoordinate=Slider(55, range=0..100))
panel_14 = Panel("the box")
brep_void_3 = Brep(brep_void_2)
panel_15 = Panel("ears")
panel_16 = Panel("tails")
sphere = Sphere(Base=construct_point_10, Radius=Slider(40, range=0..100))
sphere_2 = Sphere(Base=construct_point_11, Radius=Slider(40, range=0..100))
sph = Sphere(Base=pln_cell_phone_stand_sphere_2_origin, Radius=Slider(40, range=0..100))
sph_2 = Sphere(Base=pln_cell_phone_stand_sphere_3_origin, Radius=number_slider_2)
sph_3 = Sphere(Base=pln_cell_phone_stand_sphere_3_origin_3, Radius=Slider(7, range=0..100))
sph_4 = Sphere(Base=pln_cell_phone_stand_sphere_1_origin, Radius=Slider(56, range=0..100))
sph_5 = Sphere(Base=pln_cell_phone_stand_sphere_3_origin_2, Radius=number_slider_2)
sph_6 = Sphere(Base=pln_cell_phone_stand_sphere_2_origin_2, Radius=Slider(42, range=0..100))
# notes: To make the phone visible, set the toggle to "true".
display_phone = BooleanToggle(False)
negative_6 = Negative(Value=Slider(11, range=0..100))
brep_phone_lens = Brep(cluster_cell_phone.brep_phone_lens_4)
crv_phone_screen = Curve(cluster_cell_phone.crv_phone_screen_4)
brep_phone = Brep(cluster_cell_phone.brep_phone_4)
display_phone_center_of_gravity_axis = BooleanToggle(False)
display_phone_field_of_view_cone = BooleanToggle(False)
display_phone_void = BooleanToggle(False)
pt_phone_centroid = Point(cluster_cell_phone.pt_phone_centroid_2)
line_phone_center_of_gravity = Curve(cluster_cell_phone.line_phone_center_of_gravity_2)
brep_phone_field_of_view_cone = Brep(cluster_cell_phone.brep_phone_field_of_view_cone_4)
# notes: This output is a volume representing the void for the phone and view. This will be removed from the output of the stand design.
brep_phone_void = Brep(cluster_cell_phone.brep_phone_void_2)
construct_point_12 = ConstructPoint(XCoordinate=Slider(11, range=0..100), YCoordinate=Slider(37, range=0..100), ZCoordinate=Slider(65, range=0..100))
construct_point_13 = ConstructPoint(XCoordinate=negative_6, YCoordinate=Slider(37, range=0..100), ZCoordinate=Slider(65, range=0..100))
solid_union_3 = SolidUnion(Breps=[sphere_2, sphere])
# notes: Let us subtract the void from the spheres to get flat bottoms.
panel_17 = Panel("subtractions")
sdiff = SolidDifference(BrepsA=sph_4, BrepsB=brep_void_3)
# solid difference 实体差集 A-B
sdiff_2 = SolidDifference(BrepsA=sph_6, BrepsB=brep_void_3)
sphere_3 = Sphere(Base=construct_point_12, Radius=Slider(42, range=0..100))
sphere_4 = Sphere(Base=construct_point_13, Radius=Slider(42, range=0..100))
sdiff_3 = SolidDifference(BrepsA=sdiff, BrepsB=sdiff_2)
filter = StreamFilter(Gate=display_phone, Stream1=brep_phone)
filter_2 = StreamFilter(Gate=display_phone, Stream1=brep_phone_lens)
filter_3 = StreamFilter(Gate=display_phone, Stream1=crv_phone_screen)
filter_4 = StreamFilter(Gate=display_phone_center_of_gravity_axis, Stream1=line_phone_center_of_gravity)
filter_5 = StreamFilter(Gate=display_phone_field_of_view_cone, Stream1=brep_phone_field_of_view_cone)
filter_6 = StreamFilter(Gate=display_phone_void, Stream1=brep_phone_void)
solid_union_4 = SolidUnion(Breps=[sphere_3, sphere_4])
solid_difference = SolidDifference(BrepsA=sdiff_3, BrepsB=boxrec_8)
# notes: Let us subtract the small spherical form from the larger spherical form
panel_18 = Panel("Big sphere-small sphere")
preview = CustomPreview(Geometry=filter, Material=ColourSwatch(SwatchColor=RGB(145, 145, 145)))
preview_2 = CustomPreview(Geometry=filter_2, Material=ColourSwatch(SwatchColor=RGB(84, 84, 84)))
preview_3 = CustomPreview(Geometry=filter_3, Material=ColourSwatch(SwatchColor=RGB(99, 48, 48)))
preview_4 = CustomPreview(Geometry=filter_4, Material=ColourSwatch(SwatchColor=RGB(255, 0, 0)))
preview_5 = CustomPreview(Geometry=filter_5, Material=ColourSwatch(SwatchColor=RGBA(72, 184, 178, 186)))
preview_6 = CustomPreview(Geometry=filter_6, Material=ColourSwatch(SwatchColor=RGBA(184, 72, 72, 186)))
brep_cell_phone_stand_base = Brep(solid_difference)
brep_phone_void_2 = Brep(brep_phone_void)
solid_difference_2 = SolidDifference(BrepsA=sph_5, BrepsB=brep_phone_void_2)
solid_difference_3 = SolidDifference(BrepsA=sph_2, BrepsB=brep_phone_void_2)
brep = Brep(solid_difference_3)
brep_2 = Brep(solid_difference_2)
solid_union_5 = SolidUnion(Breps=[brep_2, brep])
solid_difference_4 = SolidDifference(BrepsA=solid_union_5, BrepsB=solid_union_3)
solid_difference_5 = SolidDifference(BrepsA=solid_union_5, BrepsB=solid_difference_4)
solid_difference_6 = SolidDifference(BrepsA=solid_difference_5, BrepsB=solid_union_4)
# notes: At this point we have a form for the stand that will hold the phone in the desired orientation relative to the surface it sits on.
sddp = ShapeDiverDocumentPayload({AbsoluteTolerance=0, AngleTolerance=0, DistanceDisplayPrecision=0, GltfVersion="Gltf2", GrasshopperVersion="1.0.0007", InputGroups="{}", OutputGroups="{}", RelativeTolerance=0, RhinoVersion="7.32.23221.10242", UnitSystem=0, VersionCreated="1.15.0.0", VersionSaved="1.15.0.0"})
solid_difference_7 = SolidDifference(BrepsA=solid_difference_5, BrepsB=solid_difference_6)
solid_difference_8 = SolidDifference(BrepsA=sph, BrepsB=brep_phone_void_2)
sdiff_4 = SolidDifference(BrepsA=brep_cell_phone_stand_base, BrepsB=brep_phone_void_2)
void_width_mm_2 = Slider(30, range=0..12000)
void_width_mm_3 = Slider(33, range=0..12000)
brep_3 = Brep(sdiff_4)
solid_union_6 = SolidUnion(Breps=[solid_difference_8, brep_3])
panel_19 = Panel("the hole")
cylinder = Cylinder(Base=PlaneXY(0, 0, 0), Radius=void_width_mm_3, Length=void_width_mm_2)
# notes: Let us remove the void representing the phone and view from the stand form.
pln_cell_phone_stand_design_origin_8 = Plane(pln_cell_phone_stand_design_origin_7)
solid_intersection = SolidIntersection(BrepsA=brep_3, BrepsB=cylinder)
# notes: We now have a form for a stand  which will hold the phone as modeled in the desired position.
solid_difference_9 = SolidDifference(BrepsA=brep_3, BrepsB=solid_intersection)
solid_union_7 = SolidUnion(Breps=[solid_difference_9, sph_3, solid_union_2, solid_union, solid_difference_7])
# notes: To see the phone in the stand, enable the phone view in the phone model.
swatch = ColourSwatch(SwatchColor=RGB(158, 84, 255))
# notes: Here we have a custom preview which will 'render' the object with the color in the swatch, in this case a mild blue.
brep_cell_phone_stand_design = Brep(solid_union_7)
# notes: What if we wanted to test if the stand was stable? Can we test that the center of gravity for the phone was inside of the stand?
preview_7 = CustomPreview(Geometry=brep_cell_phone_stand_design, Material=swatch)
# notes: Inspect the solution. If it seems viable, bake it to the layer of your choosing (default?) and print it out.
# notes: Do the walls seem too thin?
# Does it look stable (is the center of gravity for the phone over the base)?
# notes: Can we remove a cylinder from the volume to reduce the volume we need to print?
brep_bake_me = Brep(brep_cell_phone_stand_design)

# ==== cluster ClusterCellPhone
num_phone_viewing_angle = ClusterInput()
num_phone_viewing_orientation = ClusterInput()
num_phone_table_offset = ClusterInput()
pln_phone_location_on_table = ClusterInput()
num_phone_width = ClusterInput()
num_phone_length = ClusterInput()
num_phone_corner_radius = ClusterInput()
num_phone_thickness = ClusterInput()
num_phone_fit_tolerance = ClusterInput()
num_screen_offset_from_edge = ClusterInput()
num_screen_projection_inset = ClusterInput()
num_projection_distance = ClusterInput()
num_projection_offset = ClusterInput()
num_phone_viewing_angle_2 = Number(num_phone_viewing_angle)
num_phone_table_offset_2 = Number(num_phone_table_offset)
num_phone_viewing_orientation_2 = Number(num_phone_viewing_orientation)
# notes: let us construct an origin point for the cell phone.
notes = Panel("phone body")
phone_location_x_coordinate = Slider(0, range=0..300)
phone_location_y_coordinate = Slider(0, range=0..300)
phone_location_z_coordinate = Slider(0, range=0..300)
num_projection_distance_2 = Number(num_projection_distance)
num_projection_offset_2 = Number(num_projection_offset)
num_screen_projection_inset_2 = Number(num_screen_projection_inset)
# notes: let us define the screen as an offset from the outside edge of the device
notes_2 = Panel("phone screen")
num_phone_thickness_2 = Number(num_phone_thickness)
num_phone_corner_radius_2 = Number(num_phone_corner_radius)
num_phone_width_2 = Number(num_phone_width)
num_phone_length_2 = Number(num_phone_length)
num_phone_fit_tolerance_2 = Number(num_phone_fit_tolerance)
camera35mmlenslength = Slider(24, range=18..80)
# notes: let us construct an origin point for the cell phone camera relative to the origin point of the phone.
notes_3 = Panel("phone camera lens")
# notes: let us construct a representation of the field of view for the camera.
phone_lens_view_depth = Slider(3000, range=0..3000)
phone_lens_location_x_coordinate = Slider(0, range=0..300)
phone_lens_location_y_coordinate = Slider(150, range=0..300)
phone_lens_location_z_coordinate = Slider(13, range=0..300)
phone_lens_rim_offset = Slider(3, range=0..300)
phone_lens_radius = Slider(5, range=0..25)
# notes: phone camera view frustum
phone_lens_thickness = Slider(0.5, range=0..2)
pln_phone_location_on_table_2 = Plane(pln_phone_location_on_table)
# notes: This is a point that will help us conceptually connect the virtual world to the physical world.
pt_phone_origin = ConstructPoint(
    XCoordinate=phone_location_x_coordinate,
    YCoordinate=phone_location_y_coordinate,
    ZCoordinate=phone_location_z_coordinate)
num_camera35mmlenslength = Number(camera35mmlenslength)
num_screen_offset_from_edge_2 = Number(num_screen_offset_from_edge)
vec_lens_location = VectorXYZ(
    XComponent=phone_lens_location_x_coordinate,
    YComponent=phone_lens_location_y_coordinate,
    ZComponent=phone_lens_location_z_coordinate)  # -> Vector, Length
# notes: right click on the grey box allows me to name this element.
pt_phone_origin_2 = Point(pt_phone_origin)
cluster = Cluster(num_camera35mmlenslength=num_camera35mmlenslength)
division = Division(A=num_phone_width_2, B="2.0")
# notes: a reference plane whose origin is that point
xy = XYPlane(Origin=pt_phone_origin_2)
neg = Negative(Value=division)
panel = Panel(division)
neg_2 = Negative(Value=num_screen_offset_from_edge_2)
num_fov = Number(cluster)
dom = ConstructDomain(DomainStart=division, DomainEnd=neg)
pln_phone_origin = Plane(xy)
pln_phone_origin_2 = Plane(pln_phone_origin)
move = Move(Geometry=pln_phone_origin_2, Motion=vec_lens_location.Vector)  # -> Geometry, Transform
pln_phone_lens_origin = Plane(move.Geometry)
cir = Circle(Plane=pln_phone_lens_origin, Radius=phone_lens_radius)
crv_phone_lens_outline = Curve(cir)
pln_phone_lens_origin_2 = Plane(pln_phone_lens_origin)
neg_3 = Negative(Value=phone_lens_rim_offset)
panel_2 = Panel(dom)
Z = UnitZ(Factor=phone_lens_view_depth)
# notes: here we create a fustrum that more accurately reflects the camera view and what is seen on screen.
pln_phone_lens_origin_3 = Plane(pln_phone_lens_origin)
multiplication = Multiplication(A="9", B=num_fov)
# notes: with this we can set up a view to see what the camera will see while in the stand.  we can also test whether specific object will be in the field of view.
multiplication_2 = Multiplication(A="16", B=num_fov)
offset = OffsetCurve(Curve=crv_phone_lens_outline, Distance=neg_3, Corners=1)
multiplication_3 = Multiplication(A=phone_lens_view_depth, B=multiplication)
multiplication_4 = Multiplication(A=phone_lens_view_depth, B=multiplication_2)
merge = Merge(Data1=crv_phone_lens_outline, Data2=offset)  # -> flatten(Result)
panel_3 = Panel(pln_phone_lens_origin_2)
move_2 = Move(Geometry=pln_phone_lens_origin_3, Motion=Z)  # -> Geometry, Transform
num_x_size = Number(multiplication_3)
num_y_size = Number(multiplication_4)
boundary = BoundarySurfaces(Edges=merge)
# notes: this creates a rectangle from the input of a plane, X dimension, and Y dimension.
phone_rectangle = Rectangle(Plane=pln_phone_origin, XSize=dom, YSize=num_phone_length_2, Radius=num_phone_corner_radius_2)  # -> Rectangle, Length
pln_phone_lens_origin_4 = Plane(move_2.Geometry)
num_phone_fit_tolerance_3 = Number(num_phone_fit_tolerance_2)
srf_phone_lens_outline_surface = Surface(boundary)
division_2 = Division(A=num_x_size, B="2.0")
division_3 = Division(A=num_y_size, B="2.0")
num_phone_thickness_3 = Number(num_phone_thickness_2)
rectangle_length = Panel(phone_rectangle.Length)
neg_4 = Negative(Value=division_2)
neg_5 = Negative(Value=division_3)
Z_2 = UnitZ(Factor=phone_lens_thickness)
crv_phone_outline = Curve(phone_rectangle.Rectangle)
crv_phone_outline_2 = Curve(crv_phone_outline)
offset_2 = OffsetCurve(Curve=crv_phone_outline_2, Distance=neg_2, Corners=1)
panel_4 = Panel(offset_2)
crv = Curve(flatten(offset_2))
crv_phone_outline_3 = Curve(crv_phone_outline)
dom_2 = ConstructDomain(DomainStart=division_2, DomainEnd=neg_4)
dom_3 = ConstructDomain(DomainStart=division_3, DomainEnd=neg_5)
num_x_2_0 = Number(expr("x*2.0", num_phone_fit_tolerance_3))
offset_3 = OffsetCurve(Curve=crv_phone_outline_3, Distance=num_phone_fit_tolerance_3, Corners=1)  # -> flatten(Curve)
Z_3 = UnitZ(Factor=num_phone_fit_tolerance_3)
extr = Extrude(Base=srf_phone_lens_outline_surface, Direction=Z_2)
boundary_2 = BoundarySurfaces(Edges=offset_3)
pln_phone_lens_origin_5 = Plane(pln_phone_lens_origin_2)
brep_phone_lens = Brep(extr)
addition = Addition(A=num_phone_thickness_3, B=num_x_2_0)
rectangle = Rectangle(Plane=pln_phone_lens_origin_4, XSize=dom_2, YSize=dom_3, Radius=0)  # -> Rectangle, Length
srf_tolerance_phone_outline_surface = Surface(boundary_2)
rev = Reverse(Vector=Z_3)
extr_2 = ExtrudePoint(Base=rectangle.Rectangle, Point=pln_phone_lens_origin_3)
# notes: this creates a surface from the curve.  the input curve becomes the surface edge.
boundary_3 = BoundarySurfaces(Edges=crv_phone_outline)
Z_4 = UnitZ(Factor=addition)
cap = CapHoles(Brep=extr_2)
srf_phone_outline_surface = Surface(boundary_3)
brep_phone_field_of_view_cone = Brep(cap)
move_3 = Move(Geometry=srf_tolerance_phone_outline_surface, Motion=rev)  # -> Geometry, Transform
Z_5 = UnitZ(Factor=num_phone_thickness_3)
extr_3 = Extrude(Base=move_3.Geometry, Direction=Z_4)
extr_4 = Extrude(Base=srf_phone_outline_surface, Direction=Z_5)
vec = Vector(Z_5)
move_4 = Move(Geometry=crv, Motion=vec)  # -> Geometry, Transform
crv_phone_screen = Curve(move_4.Geometry)
num_screen_projection_inset_3 = Number(num_screen_projection_inset_2)
num_projection_distance_3 = Number(num_projection_distance_2)
num_projection_offset_3 = Number(num_projection_offset_2)
cluster_2 = Cluster_2(
    crv_phone_screen=crv_phone_screen,
    num_screen_inset=num_screen_projection_inset_3,
    num_projection_distance=num_projection_distance_3,
    num_projection_offset=num_projection_offset_3)
brep_phone = Brep(extr_4)
brep_phone_field_of_view_cone_2 = Brep(brep_phone_field_of_view_cone)
brep_screen_viewing_volume = Brep(cluster_2)
srf_phone_outline_surface_2 = Surface(boundary_3)
brep_tolerance_phone = Brep(extr_3)
pln_phone_lens_origin_6 = Plane(pln_phone_lens_origin_5)
crv_phone_outline_4 = Curve(phone_rectangle.Rectangle)
crv_phone_screen_2 = Curve(move_4.Geometry)
pln_phone_origin_3 = Plane(xy)
brep_phone_lens_2 = Brep(brep_phone_lens)
brep_phone_2 = Brep(brep_phone)
pln_phone_location_on_table_3 = Plane(pln_phone_location_on_table_2)
merge_phone_components = Merge(
    Data1=pln_phone_origin_3,
    Data2=crv_phone_outline_4,
    Data3=srf_phone_outline_surface_2,
    Data4=brep_phone_2,
    Data5=brep_phone_lens_2,
    Data6=pln_phone_lens_origin_6,
    Data7=brep_phone_field_of_view_cone_2,
    Data8=crv_phone_screen_2,
    Data9=brep_tolerance_phone,
    Data10=brep_screen_viewing_volume)
num_phone_table_offset_3 = Number(num_phone_table_offset_2)
pln_phone_location_on_table_4 = Plane(pln_phone_location_on_table_3)

# ----
# notes: adjust phone location relative to table
phone_table_offset = Slider(16, range=-50..50)
num_phone_table_offset_4 = Number(num_phone_table_offset_3)
num_phone_table_offset_5 = Number(num_phone_table_offset_4)
Z_6 = UnitZ(Factor=num_phone_table_offset_5)
move_5 = Move(Geometry=pln_phone_location_on_table_4, Motion=Z_6)  # -> Geometry, Transform

pln_phone_location_above_table = Plane(move_5.Geometry)
pln_phone_location_on_table_5 = Plane(pln_phone_location_on_table_4)
vec2pt = Vector2Pt(PointA=pln_phone_location_on_table_5, PointB=pln_phone_location_above_table, Unitize=False)  # -> Vector, Length
vdis = VectorDisplay(Anchor=pln_phone_location_on_table_5, Vector=vec2pt.Vector)
num_phone_viewing_angle_3 = Number(num_phone_viewing_angle_2)
pln_phone_location_on_table_6 = Plane(pln_phone_location_on_table_2)
pln_phone_location_above_table_2 = Plane(pln_phone_location_above_table)
pln_phone_location_above_table_3 = ClusterOutput(pln_phone_location_above_table_2)
pln_phone_location_on_table_7 = ClusterOutput(pln_phone_location_on_table_6)

# ----
# notes: set the viewing orientation, "portrait/landscape"
geo_phone_components = Geometry(merge_phone_components)
portrait_landscape = ValueList({"portrait 0": "0", "landscape 90": "90", "portrait 180": "180", "landscape 270": "270"}, selected="landscape 90")
num_phone_viewing_orientation_3 = Number(num_phone_viewing_orientation_2)
item = ListItem(List=geo_phone_components, Index="0", Wrap=True)
item_2 = ListItem(List=geo_phone_components, Index="2", Wrap=True)
srf_phone_outline_surface_3 = Surface(item_2)
pln_phone_origin_4 = Plane(item)
area = Area(Geometry=srf_phone_outline_surface_3)  # -> Area, Centroid
pl_origin = PlaneOrigin(Base=pln_phone_origin_4, Origin=area.Centroid)

num_phone_viewing_orientation_4 = Number(num_phone_viewing_orientation_3)

rotate = Rotate(Geometry=geo_phone_components, Angle=degrees(num_phone_viewing_orientation_4), Plane=pl_origin)  # -> Geometry, Transform
geo_phone_components_2 = Geometry(rotate.Geometry)

# ----
# notes: move phone location based on orientation
pln_phone_location_above_table_4 = Plane(pln_phone_location_above_table)
geo_phone_components_3 = Geometry(geo_phone_components_2)
item_3 = ListItem(List=geo_phone_components_3, Index="0", Wrap=True)
pln_phone_origin_5 = Plane(item_3)
vec2pt_2 = Vector2Pt(PointA=pln_phone_origin_5, PointB=pln_phone_location_above_table_4, Unitize=False)  # -> Vector, Length
geo_phone_components_4 = Geometry(geo_phone_components_3)
item_4 = ListItem(List=geo_phone_components_4, Index="1", Wrap=True)
crv_phone_outline_5 = Curve(item_4)
crv_cp = CurveClosestPoint(Point=pln_phone_location_above_table_4, Curve=crv_phone_outline_5)  # -> Point, Parameter, Distance
vec2pt_3 = Vector2Pt(PointA=crv_cp.Point, PointB=pln_phone_location_above_table_4, Unitize=False)  # -> Vector, Length
move_6 = Move(Geometry=geo_phone_components_4, Motion=vec2pt_3.Vector)  # -> Geometry, Transform
vdis_2 = VectorDisplay(Anchor=crv_cp.Point, Vector=vec2pt_3.Vector)
geo_phone_components_5 = Geometry(move_6.Geometry)

# ----
# notes: rotate the phone to viewing position
geo_phone_components_6 = Geometry(geo_phone_components_5)
num_zero = Number(0)
item_5 = ListItem(List=geo_phone_components_6, Index="0", Wrap=True)
num_phone_viewing_direction = Number(num_zero)
pln_phone_origin_6 = Plane(item_5)
rotate_2 = Rotate(Geometry=geo_phone_components_6, Angle=degrees(num_phone_viewing_direction), Plane=pln_phone_origin_6)  # -> Geometry, Transform
geo_phone_components_7 = Geometry(rotate_2.Geometry)

pln_phone_location_above_table_5 = Plane(pln_phone_location_above_table_4)

# ----
# notes: rotate the phone to viewing position "up/down"
geo_phone_components_8 = Geometry(geo_phone_components_7)
phone_viewing_angle = Slider(72, range=0..360)
deplane = DeconstructPlane(Plane=pln_phone_location_above_table_5)  # -> Origin, XAxis, YAxis, ZAxis
num_phone_viewing_angle_4 = Number(num_phone_viewing_angle_3)
line = LineSDL(Start=deplane.Origin, Direction=deplane.XAxis, Length=1)
rotax = RotateAxis(Geometry=geo_phone_components_8, Angle=degrees(num_phone_viewing_angle_4), Axis=line)  # -> Geometry, Transform
geo_phone_components_9 = Geometry(rotax.Geometry)

geo_phone_components_10 = Geometry(geo_phone_components_9)
geo_phone_components_11 = Geometry(geo_phone_components_10)
geo_phone_components_12 = Geometry(geo_phone_components_11)
item_6 = ListItem(List=geo_phone_components_12, Index="0", Wrap=True)
item_7 = ListItem(List=geo_phone_components_12, Index="2", Wrap=True)
item_8 = ListItem(List=geo_phone_components_12, Index="3", Wrap=True)
item_9 = ListItem(List=geo_phone_components_12, Index="4", Wrap=True)
item_10 = ListItem(List=geo_phone_components_12, Index="6", Wrap=True)
item_11 = ListItem(List=geo_phone_components_12, Index="7", Wrap=True)
item_12 = ListItem(List=geo_phone_components_12, Index="8", Wrap=True)
item_13 = ListItem(List=geo_phone_components_12, Index="9", Wrap=True)
srf_phone_outline_surface_4 = Surface(item_7)
brep_phone_3 = Brep(item_8)
brep_phone_lens_3 = Brep(item_9)
pln_phone_origin_7 = Plane(item_6)
crv_phone_screen_3 = Curve(item_11)
brep_tolerance_phone_2 = Brep(item_12)
brep_screen_viewing_volume_2 = Brep(item_13)
brep_phone_field_of_view_cone_3 = Brep(item_10)
merge_2 = Merge(Data1=brep_tolerance_phone_2, Data2=brep_screen_viewing_volume_2)
volume = Volume(Geometry=brep_phone_3)  # -> Volume, Centroid
pt_phone_centroid = Point(volume.Centroid)
num_phone_volume = Number(volume.Volume)
sunion = SolidUnion(Breps=merge_2)
fmerge = MergeFaces(Brep=sunion)  # -> Breps, Before, After
project = Project(Geometry=pt_phone_centroid, Plane=pln_phone_location_on_table_6)  # -> Geometry, Transform
brep_phone_void = Brep(fmerge.Breps)
ln = Line(StartPoint=pt_phone_centroid, EndPoint=project.Geometry)
line_phone_center_of_gravity = Line(ln)
line_phone_center_of_gravity_2 = ClusterOutput(line_phone_center_of_gravity)
pln_phone_origin_8 = ClusterOutput(pln_phone_origin_7)
srf_phone_outline_surface_5 = ClusterOutput(srf_phone_outline_surface_4)
brep_phone_4 = ClusterOutput(brep_phone_3)
num_phone_volume_2 = ClusterOutput(num_phone_volume)
pt_phone_centroid_2 = ClusterOutput(pt_phone_centroid)
brep_phone_lens_4 = ClusterOutput(brep_phone_lens_3)
crv_phone_screen_4 = ClusterOutput(crv_phone_screen_3)
brep_tolerance_phone_3 = ClusterOutput(brep_tolerance_phone_2)
brep_screen_viewing_volume_3 = ClusterOutput(brep_screen_viewing_volume_2)
brep_phone_field_of_view_cone_4 = ClusterOutput(brep_phone_field_of_view_cone_3)
brep_phone_void_2 = ClusterOutput(brep_phone_void)

# ==== cluster Cluster
num_camera35mmlenslength = ClusterInput()
# notes: these values were determined empirically. this equation may require adjestment depending on your setup.
num_camera35mmlenslength_2 = Number(num_camera35mmlenslength)
num = Number("2/30")
num_2 = Number("40")
multiplication = Multiplication(A=num_2, B=num)
division = Division(A=multiplication, B=num_camera35mmlenslength_2)
panel = Panel(division)
panel_2 = Panel(multiplication)
num_fov = Number(division)
num_fov_2 = ClusterOutput(num_fov)

# ==== cluster Cluster_2
num_projection_distance = ClusterInput()
num_projection_offset = ClusterInput()
crv_phone_screen = ClusterInput()
num_screen_inset = ClusterInput()
num_projection_distance_2 = Number(num_projection_distance)
num_projection_offset_2 = Number(num_projection_offset)
crv_phone_screen_2 = Curve(crv_phone_screen)
num_screen_inset_2 = Number(num_screen_inset)
offset = OffsetCurve(Curve=crv_phone_screen_2, Distance=Slider(0, range=0..10), Corners=3)  # -> flatten(Curve)
crv_phone_screen_3 = Curve(offset)
boundary = BoundarySurfaces(Edges=crv_phone_screen_3)
area = Area(Geometry=boundary)  # -> Area, Centroid
srf_cp = SurfaceClosestPoint(Point=area.Centroid, Surface=boundary)  # -> Point, UVPoint, Distance
evalsrf = EvaluateSurface(Surface=boundary, Point=srf_cp.UVPoint)  # -> Point, Normal, UDirection, VDirection, Frame
num_projection_distance_3 = Number(num_projection_distance_2)
num_projection_offset_3 = Number(num_projection_offset_2)
num_screen_inset_3 = Number(num_screen_inset_2)
vec = Vector(evalsrf.Normal)
crv_phone_screen_4 = Curve(crv_phone_screen_3)
amp = Amplitude(Vector=vec, Amplitude=num_screen_inset_3)
amp_2 = Amplitude(Vector=vec, Amplitude=num_projection_distance_3)
move = Move(Geometry=crv_phone_screen_4, Motion=amp)  # -> Geometry, Transform
move_2 = Move(Geometry=move.Geometry, Motion=amp_2)  # -> Geometry, Transform
offset_2 = OffsetCurve(Curve=move_2.Geometry, Distance=num_projection_offset_3, Corners=1)  # -> flatten(Curve)
rulesrf = RuledSurface(CurveA=crv_phone_screen_4, CurveB=move.Geometry)
rulesrf_2 = RuledSurface(CurveA=move.Geometry, CurveB=offset_2)
cap = CapHoles(Brep=rulesrf)
cap_2 = CapHoles(Brep=rulesrf_2)
merge = Merge(Data1=cap, Data2=cap_2)
sunion = SolidUnion(Breps=merge)
brep_screen_viewing_volume = Brep(sunion)
brep_screen_viewing_volume_2 = ClusterOutput(brep_screen_viewing_volume)
